# Dynamo graph Audit_Model_Review_and_ExportToExcel.dyn (Dynamo 2.3.0.5885)

# group: DEFINITION
# note: DESIGN
# note: USE:
# FOR THE BACK-END FUNCTIONALITY

# group: WIP
# note: WIP
# note: USE:
# FOR "WORK IN PROGRESS"

# group: INPUT
# note: CONTROL
# note: USE:
# FOR THE USER INPUT (SUCH AS SLIDERS,
#  NUMBERS, ....)

# group: BEST PRACTICE GUIDE
# note: GUIDE
# 1. DIVIDE THE DYNAMO DEFINITION INTO THE USER INTERFACE AND THE BACK-END
# 2. BUILD THE DEFINITION WITH SMALL BLOCKS
# 3. BLOCKS SHOULD ALWAYS HAVE INPUT/OUTPUT
# 4. RENAME INPUT/OUTPUT CONTAINERS TO DATA THEY CARRY
# 5. COLOR-CODE BLOCKS ACCORDING TO THE TEMPLATE
# 6. NAMING CONVENTION:
# <USE>_<AFFECTED REVIT ELEMENTS/GEOMETRY>

# group: REFERENCES
# note: INPUT
# note: USE:
# FOR THE INCOMMING REFFERENCES
# (FILE PATHS, GEOMETRIES ...                     )

# group: OUTPUT
# note: TO REVIT
# note: USE:
# FOR BLOCKS THAT EXPORT THE GEOMETRY AND PARAMETERS TO REVIT

# group: INFO
# note: CREATED BY: <USERNAME>
# DYNAMO VERSION: <Dynamo 1.3.0>
# PACKAGES:
# <REQUIRED PACKAGES>
# PROJECT SPECIFIC:
# <PROJECT NO>/NO

# group: WATCH
# note: MONITOR
# note: USE:
# FOR IMPORTANT WATCH NODES

# group: ANNOTATION
# note: ANNOTATION
# note: USE:
# FOR COMMENTS

# group: NOTE
NOTE = CodeBlock()  # //COPY THE GROUPS TO YOUR DEFINITION

directory_path = Directory("C:\REVIT_LOCAL2019")  # graph input
string = StringInput("\")
file_name = StringInput("ModelReview")  # graph input
code_block = CodeBlock(a=directory_path, div=string, b=file_name) { a+div+b+".xlsx"; }
code_block_2 = CodeBlock { true; }
python_script = Python(IN[0]=code_block_2)
# ---------- python_script.python (551 lines) ----------
#Copyright(c) 2018, Maciej Wypych


import clr
clr.AddReference('ProtoGeometry')
from Autodesk.DesignScript.Geometry import *

# Import DocumentManager and TransactionManager
clr.AddReference("RevitServices")
import RevitServices
from RevitServices.Persistence import DocumentManager
from RevitServices.Transactions import TransactionManager
import System


# Import RevitAPI
clr.AddReference("RevitAPI")
import Autodesk
from Autodesk.Revit.DB import *


#doc = DocumentManager.Instance.CurrentDBDocument
uiapp = DocumentManager.Instance.CurrentUIApplication
app = uiapp.Application
#Import sys module
import sys
#Specify location path for IronPython install
pyt_path = r'C:\Program Files (x86)\IronPython 2.7\Lib'
sys.path.append(pyt_path)
import os
import math

clr.AddReference("System")
from System.Collections.Generic import List
from System.Collections.Generic import *
from collections import Counter

clr.AddReference("System.Core")
clr.ImportExtensions(System.Linq)

ft2mm = 304.8
#The inputs to this node will be stored as a list in the IN variable.
dataEnteringNode = IN

if IN[0]==True:
	
 	AllDocs = app.Documents
	Docs=[]
	for i in AllDocs:
		if not i.IsLinked and not i.IsFamilyDocument:
			Docs.append(i)
	for i in AllDocs:
		if i.IsLinked and not i.IsFamilyDocument:
			Docs.append(i)

	allinfo=[]
	DocN=[]
	allfp=[]
	for j,i in enumerate(Docs):
		title = i.Title
		tlen = len(title)
		if j == 0:
			DocN.append(title[:30])
		else:
			DocN.append("Link"+j.ToString()+"-"+ title[:24])
	for doc in Docs:
		
		
		try:
			modelPath = doc.GetWorksharingCentralModelPath()
			fullPath = ModelPathUtils.ConvertModelPathToUserVisiblePath(modelPath)
		except:
			fullPath = doc.PathName
		
		allfp.append(fullPath)
	
		if fullPath.StartsWith("BIM 360"):
			folder1 = os.path.abspath(os.path.expandvars("%userprofile%") + "\\AppData\\Local\\Autodesk\\Revit\\Autodesk Revit " + app.VersionNumber + "\\CollaborationCache")
   		  	
   		  	revitFile = doc.WorksharingCentralGUID.ToString() + ".rvt"
	  		rname =doc.WorksharingCentralGUID.ToString()
	  		for root, dirs, files in os.walk(folder1):
	  			for name in files:
	  				if name == revitFile:
	  					rf1 = name
	  		fname= ["File Name",doc.Title]
			fpath = ["File Path","BIM360"]
			iscentral = ["Is This a Central file","BIM360"]
			rvtnames = ["Linked Revit File Name"]
			
			
			rvtsize = ["Linked Revit File Size"]
			rvtpaths= ["Linked Revit File Path"]
			cadpaths= ["Linked CAD File Path"]
			cadnames = ["Linked CAD File"]
			cadsize=["Linked CAD File Size"]
			fsize = ["File Size"]
		else: 
			#  if len(files)>0:
			#	length = System.IO.FileInfo(files[0]).Length
			 # 	fsize = Convert.ToInt32(Math.Round(length / BYTES_TO_MB))
			  
			fsize = ["File Size",str(os.path.getsize(doc.PathName)) + " Kb"]
			fname= ["File Name",doc.Title]
			fpath = ["File Path",doc.PathName]
			iscentral = ["Is This a Central file","BasicFileInfo.Extract(doc.PathName).IsCentral"]
			
			
			
			
			fp =  ModelPathUtils.ConvertUserVisiblePathToModelPath(doc.PathName)
			transdata = TransmissionData.ReadTransmissionData(fp)
			extref = transdata.GetAllExternalFileReferenceIds()
			eref  = [transdata.GetLastSavedReferenceData(i) for i in extref]
			
			paths = [ModelPathUtils.ConvertModelPathToUserVisiblePath(e.GetAbsolutePath()) for e in eref]
			linkedFiles = FilteredElementCollector(doc).OfClass(RevitLinkInstance)
			linkdoc=[]
			try:
				for i in linkedFiles:
					linkdoc.append(i.GetLinkDocument())
				rvtpaths=[]
				for i in linkdoc:
					rvtpaths.append(i.PathName)
			except:
				import traceback
				errorReport = traceback.format_exc()
			rvtnames = []
			
			rvtsize = [str(os.path.getsize(p)) + " Kb" for p in rvtpaths]
			for p in rvtpaths:
				if '/' in p:
					rvtnames.append(p.rsplit('/', 1)[-1])
				else:
					rvtnames.append(p.rsplit('\\', 1)[-1])
			cadpaths = [p for p in paths if p.endswith('.dwg')]
			cadnames = ["Linked CAD File"]
			#cadsize = [str(os.path.getsize(p)) + " Kb" for p in cadpaths]
			cadsize =[]
			cadsize.insert(0,"Linked CAD File Size")
			for p in cadpaths:
				if '/' in p:
					cadnames.append(p.rsplit('/', 1)[-1])
				else:
					cadnames.append(p.rsplit('\\', 1)[-1])
			rvtnamesSorted=sorted(rvtnames)
			rvtpathsSorted=[x for _,x in sorted(zip(rvtnames,rvtpaths))]
			rvtsizeSorted=[x for _,x in sorted(zip(rvtnames,rvtsize))]
			rvtsizeSorted.insert(0,"Linked Revit File Size")
			rvtpathsSorted.insert(0,"Linked Revit File Path")
			cadpaths.insert(0,"Linked CAD File Path")
			rvtnamesSorted.insert(0,"Linked Revit File Name")
			
		collector = FilteredElementCollector(doc)
		
		detgroups = FilteredElementCollector(doc).OfCategory(BuiltInCategory.OST_IOSDetailGroups).WhereElementIsNotElementType().ToElements()
		detgroupsnames = [i.Name for i in detgroups]
		modgroups = FilteredElementCollector(doc).OfCategory(BuiltInCategory.OST_IOSModelGroups).WhereElementIsNotElementType().ToElements()
		modgroupsnames = [i.Name for i in modgroups]
		#levels = collector.OfCategory(BuiltInCategory.OST_Levels)
		families = []
		categories =[i for i in System.Enum.GetValues(BuiltInCategory) if "OST" in i.ToString() ]
		
		groups = FilteredElementCollector(doc).OfCategory(BuiltInCategory.OST_IOSModelGroups).WhereElementIsNotElementType().ToElements()
		CAD = FilteredElementCollector(doc).OfClass(ImportInstance).ToElements()
		Worksets = FilteredWorksetCollector(doc).OfKind(WorksetKind.UserWorkset)
		levels = FilteredElementCollector(doc).OfCategory(BuiltInCategory.OST_Levels).WhereElementIsNotElementType().ToElements()
		grids = FilteredElementCollector(doc).OfCategory(BuiltInCategory.OST_Grids).WhereElementIsNotElementType().ToElements()
		basePt = FilteredElementCollector(doc).OfClass(BasePoint).ToElements()
		projBasePt = None
		
		#--------------------------------------------------------------------------
		# List Badly Named Families by Category
		#--------------------------------------------------------------------------
		fams = (FilteredElementCollector(doc).OfClass(Family).Where(lambda f: f.IsEditable and f.Name.StartsWith('Family')).ToList())
		BadlyNamedCategories=["Categories with Badly Named Families"]
		BadlyNamedFamilies=["Badly Named Families"]
		
		for fam in fams: 
  			thecat = fam.FamilyCategory.Name
			theName = fam.Name
			BadlyNamedCategories.append(thecat)
			BadlyNamedFamilies.append(theName)
		
		# List Badly Named Detail Groups
		DGroups = (FilteredElementCollector(doc).OfCategory(BuiltInCategory.OST_IOSDetailGroups).Where(lambda dg: Element.Name.GetValue(dg).StartsWith('Group') and type(dg) == GroupType))
		for dg in DGroups:
  			theName = Element.Name.GetValue(dg)
			BadlyNamedCategories.append("Detail Group")
			BadlyNamedFamilies.append(theName)
		
		# List Badly Named Model Groups		
		MGroups = (FilteredElementCollector(doc).OfCategory(BuiltInCategory.OST_IOSModelGroups).Where(lambda mg: Element.Name.GetValue(mg).StartsWith('Group') and type(mg) == GroupType))
		for mg in MGroups:
  			theName = Element.Name.GetValue(mg)
			BadlyNamedCategories.append("Model Group")
			BadlyNamedFamilies.append(theName)
		
		#--------------------------------------------------------------------------
		# List In-Place Families
		#--------------------------------------------------------------------------
		inplaces = (
		FilteredElementCollector(doc)
		.OfClass(Family)
		.Where(lambda f: f.IsInPlace)
		.OrderBy(lambda c: c.FamilyCategory.Name)
		.ToList()
		)
		
		InPlaceCategories = ["In Place Category"]
		InPlaceFamilies = ["In Place Family"]
		
		for inplace in inplaces:
			InPlaceCategories.append(inplace.FamilyCategory.Name)
			InPlaceFamilies.append(inplace.Name)
			
		#--------------------------------------------------------------------------
		# List Inserted Images and Size where avaiable.
		#--------------------------------------------------------------------------
		MB = 1050625.0 #<--- Conversion bytes to MB (1024 x 1024)
		
		imageNames = ["Image Name"]
		imagePaths = ["Location Images Loaded From"]
		imageSizeMB = ["Image size in MB"]
		
		theImages = (
		FilteredElementCollector(doc)
		.OfCategory(BuiltInCategory.OST_RasterImages)
		.OrderBy(lambda i: Element.Name.GetValue(i))
		)
		
		imageTypes = []
		imageInstances = []
		
		for anImage in theImages:
		  if ImageType == type(anImage):
		    imageTypes.Add(anImage)
		  else:
		    imageInstances.Add(anImage)
		    
		for anImage in imageTypes:
		  #Initialise the size at zero
		  theSize = 0
		  try:
		    #if you find the file on disk grab the path and then the size
		    thePath = anImage.Path
		    theSize = round(os.path.getsize(thePath) / MB,3)
		  except:
		    thePath = 'Not Found'
		    pass
		  #Grab the image Name  
		  theName = Element.Name.GetValue(anImage)
		  
		  imageNames.append(theName)
		  imagePaths.append(thePath)
		  imageSizeMB.append(str(theSize))
		
		#--------------------------------------------------------------------------
		# Get Design Option & Sets Information
		#--------------------------------------------------------------------------
		theOptionSets = FilteredElementCollector(doc).OfCategory(BuiltInCategory.OST_DesignOptionSets)
		theOptions = FilteredElementCollector(doc).OfCategory(BuiltInCategory.OST_DesignOptions)
		
		OptionSetNums = ["N°"]
		OptionSetNames = ["Option Set"]
		DesignOptions = ["Design Option"]
		
		optionSets = {}
		setCounter = 0
		
		for anOption in theOptions:
		  #If the Design Option Set is already recorded, just add the option to it's list of options
		  optionSetId = anOption.LookupParameter('Design Option Set Id').AsElementId()
		  
		  # Check if this is an option within an existing 
		  # option set or a new option set
		  if optionSetId in optionSets:
		    optionSets[optionSetId].append(anOption)
		  else:
		    optionSets.Add(optionSetId,[])
		    optionSets[optionSetId].append(anOption)
				
		# Output the results
		if optionSets.Count > 0:
		  # Print the name of Each Option Set, then its Options
		  for optionSet in optionSets:
		    theOptionSet = doc.GetElement(optionSet)
		    setCounter += 1
		    
		    OptionSetNums.append(setCounter.ToString().zfill(2)) #2 digit number
		    OptionSetNames.append(theOptionSet.Name)
		    DesignOptions.append("")
		    
		    # Print all of the options within the Option Set
		    for op in optionSets[optionSet]:
		      OptionSetNums.append("'-")
		      OptionSetNames.append("'-")
		      DesignOptions.append(op.Name)
		
		#--------------------------------------------------------------------------
		# Get 2D Elements per view sorted by highest number
		#--------------------------------------------------------------------------
		
		
		#--------------------------------------------------------------------------
		ImportedCADNames = ["Imported DWG Name"]
		Views=["View Name"]
		SheetNo=["Sheet Number"]
		SheetName=["Sheet Name"]
		Workset=[]
		WorksetGUID=[]
		DetGroup=[]
		DetGroupCount=[]
		cat=[]
		warningsdesc=[]
		warningstext=[]
		number=[]
		revitVer=["Revit Version"]
		revitBuild=["Revit Build"]
		phases=["Phases"]
		levelNames=["Levels"]
		levelElevation=["Level Elevation (Project)"]
		levelElevationSurvey=["Level Elevation (Survey)"]
		gridNames=["Grids"]
		location=["Location"]
		site=["Site"]
		outProjBasePt=["Project Base Point"]
		outProjSurvPt=["Survey Point"]
		projectInfo=[]
		
		if revitVer == "2017":
			projectPos = doc.ActiveProjectLocation.ProjectPosition
		else:
			projectPos=doc.ActiveProjectLocation.GetProjectPosition(XYZ(0,0,0))
		if projectPos==None:
			location.append("No Project Position at origin point")
		else:
			location.append("Angle")
			location.append((projectPos.Angle*180/math.pi).ToString())
			location.append("NorthSouth")
			location.append((projectPos.NorthSouth* ft2mm).ToString())
			location.append("EastWest")
			location.append((projectPos.EastWest* ft2mm).ToString())
			location.append("Elevation")
			location.append((projectPos.Elevation* ft2mm).ToString())
			location.append("Sites")		
		siteLoc = doc.ActiveProjectLocation.GetSiteLocation()
		
		
		site.append("GeoCoordinateSystemDefinition")
		site.append(siteLoc.GeoCoordinateSystemDefinition.ToString())
		site.append("GeoCoordinateSystemId")
		site.append(siteLoc.GeoCoordinateSystemId.ToString())
		site.append("Latitude")
		site.append(siteLoc.Latitude.ToString())
		site.append("Longitude")
		site.append(siteLoc.Longitude.ToString())
		site.append("PlaceName")
		site.append(siteLoc.PlaceName.ToString())
		site.append("TimeZone")
		site.append(siteLoc.TimeZone.ToString())
		
		for e in basePt:
			a = e.Category.Name
			if a == "Project Base Point":
				try:			
					pbpEW = e.LookupParameter("E/W")
					pbpNS = e.LookupParameter("N/S")
					pbpElev = e.LookupParameter("Elev")
					pbpAngle = e.LookupParameter("Angle to True North")
					outProjBasePt.append("E/W")
					outProjBasePt.append(round(pbpEW.AsDouble()*ft2mm,6))
					outProjBasePt.append("N/S")
					outProjBasePt.append(round(pbpNS.AsDouble()*ft2mm,6))
					outProjBasePt.append("Elev")
					outProjBasePt.append(round(pbpElev.AsDouble()*ft2mm,6))
					outProjBasePt.append("Angle to True North")
					outProjBasePt.append(round(pbpAngle.AsDouble()*180/math.pi,6))
				except:
					None
			elif a == "Survey Point":
				pspEW = e.LookupParameter("E/W")
				pspNS = e.LookupParameter("N/S")
				pspElev = e.LookupParameter("Elev")
				outProjSurvPt.append("E/W")
				outProjSurvPt.append(round(pspEW.AsDouble()*ft2mm,6))
				outProjSurvPt.append("N/S")
				outProjSurvPt.append(round(pspNS.AsDouble()*ft2mm,6))
				outProjSurvPt.append("Elev")
				outProjSurvPt.append(round(pspElev.AsDouble()*ft2mm,6))
		
		for i in doc.ProjectLocations: 
			try:
				location.append(i.Name)
			except:
				location.append(i.ToString())
		for i in levels:
				levelElevation.append((i.Elevation*ft2mm).ToString())
				levelNames.append(i.Name)
				if projectPos==None:
					levelElevationSurvey.append((i.Elevation*ft2mm).ToString())
				else:
					levelElevationSurvey.append(((projectPos.Elevation+i.Elevation)*ft2mm).ToString())
				
		try:
			errorReport = None
			warnings = doc.GetWarnings();
			for i in warnings:
				warningsdesc.append(i.GetDescriptionText())
			
				
			warningstext=Counter(warningsdesc).keys()
			warningstext.insert(0,"Warnings")
			number=Counter(warningsdesc).values()
			number.insert(0,"Number")
			for i in doc.Phases:
				phases.append(i.Name)
			revitVer.append(doc.Application.VersionNumber.ToString())
			revitBuild.append(doc.Application.VersionBuild.ToString())
			
					
			for i in grids:
				gridNames.append(i.Name)
			pInfo = doc.ProjectInformation
			if pInfo!=None:
				projectInfo.append("Project Name")
				projectInfo.append(pInfo.Name)
				projectInfo.append("Project Number")
				projectInfo.append(pInfo.Number)
				projectInfo.append("Project Status")
				projectInfo.append(pInfo.Status)
				projectInfo.append("Project Address")
				projectInfo.append(pInfo.Address)
				projectInfo.append("Client Name")
				projectInfo.append(pInfo.ClientName)



		except:
			# if error accurs anywhere in the process catch it
			import traceback
			errorReport = traceback.format_exc()
			
		
		for i in CAD:
			if not i.IsLinked:
				ImportedCADNames.append(i.GetParameters("Name")[0].AsString())
				if not i.IsLinked:
					try:
						Views.append(i.Document.GetElement(i.OwnerViewId).GetParameters("View Name")[0].AsString())
					except:
						Views.append("No data")			
					try:
						SheetNo.append(i.Document.GetElement(i.OwnerViewId).GetParameters("Sheet Number")[0].AsString())
					except:
						SheetNo.append("No data")
					try:
						SheetName.append(i.Document.GetElement(i.OwnerViewId).GetParameters("Sheet Name")[0].AsString())
					except:
						SheetName.append("No data")
		
		#Get Worksets				
		for i in Worksets:
			Workset.append(i.Name)
			WorksetGUID.append(i.UniqueId)
		WorksetSorted=sorted(Workset)
		WorksetSorted.insert(0,"Worksets")
		WorksetGUIDSorted=[x for _,x in sorted(zip(Workset,WorksetGUID))]
		WorksetGUIDSorted.insert(0,"Worksets GUID")
		#Get Detail groups and count unique using Counter - from collections import Counter
		DetGroup = Counter(detgroupsnames).keys()
		DetGroup.insert(0,"Detail Group Names")
		DetGroupCount = Counter(detgroupsnames).values()
		DetGroupCount.insert(0,"Detail Group Count")
		
		ModGroup = Counter(modgroupsnames).keys()
		ModGroup.insert(0,"Model Group Names")
		ModGroupCount = Counter(modgroupsnames).values()
		ModGroupCount.insert(0,"Model Group Count")
		
		AllFamilies=["Number of Families"]
		NoGeneric=["Number of Generic Models"]
		PercGeneric=["Percentage of Generic Model"]
		NoDetailLines=["Number of Lines"]
		PercLines=["Percentage of Lines"]
		
		
		for i in categories:
			lst = FilteredElementCollector(doc).WhereElementIsNotElementType().OfCategory(i).ToElements()
			#lst = FilteredElementCollector(doc).OfClass(FamilyInstance).WhereElementIsNotElementType().OfCategory(i).ToElements()
			if len(lst)>0:
				cat.append(i.ToString()[4:])
				families.append(len(lst))
			if len(lst)>0 and i.ToString()=="OST_GenericModel":
				NoGeneric.append(len(lst))
		
		catSorted=sorted(cat)
		famSorted=[x for _,x in sorted(zip(cat,families))]
		catSorted.insert(0,"Categories")
		famSorted.insert(0,"Number of Elements")
		lstlns = FilteredElementCollector(doc).OfCategory(BuiltInCategory.OST_Lines).WhereElementIsNotElementType().ToElements()
		if len(lstlns)>0:
			NoDetailLines.append(len(lstlns))
		
			
		try:
			PercGeneric.append(float(NoGeneric[1])/sum(families)*100)
			
		except:
			PercGeneric.append("Unable to calculate")
			
		try:
			PercLines.append(float(NoDetailLines[1])/sum(families)*100)
		except:
			PercLines.append("Unable to calculate")
		try:
			AllFamilies.append(sum(families))
		except:
			AllFamilies.append("Unable to calculate")
			
		
		Combined =[]
		
		for i in fname:
			Combined.append(i)
		for i in fpath:
			Combined.append(i)
		for i in fsize:
			Combined.append(i)
		for i in revitVer:
			Combined.append(i)
		for i in revitBuild:
			Combined.append(i)
		for i in projectInfo:
			Combined.append(i)
		for i in AllFamilies:
			Combined.append(i)
		for i in NoGeneric:
			Combined.append(i)
		for i in PercGeneric:
			Combined.append(i)
		for i in NoDetailLines:
			Combined.append(i)
		for i in PercLines:
			Combined.append(i)		
		
		
		allinfo.append([Combined,warningstext,number,["Error Rating Score"],[],catSorted,[],famSorted,[],ModGroup,ModGroupCount,[],DetGroup,DetGroupCount,BadlyNamedCategories,BadlyNamedFamilies,InPlaceCategories,InPlaceFamilies,WorksetSorted,WorksetGUIDSorted,phases,levelNames,levelElevation,levelElevationSurvey,gridNames,location,site,outProjBasePt,outProjSurvPt,[],imageNames,imagePaths,imageSizeMB,ImportedCADNames,SheetNo,SheetName,Views,[],OptionSetNums,OptionSetNames,DesignOptions,[],cadnames,cadpaths,cadsize,[],rvtnames,rvtpaths,rvtsize])
		
	
OUT = DocN,allinfo
# ----------------------------------------
code_block_3 = CodeBlock(sheetname=python_script) { sheetname[0]; }
string_from_object = FromObject(obj=code_block_3)
reverse = List.Reverse(list=string_from_object)
code_block_4 = CodeBlock { 0; }
code_block_5 = CodeBlock(data=python_script) { data[1]; }
string_from_object_2 = FromObject(obj=code_block_5)
transpose = List.Transpose(lists=string_from_object_2@@L3)
reverse_2 = List.Reverse(list=transpose)
boolean = BoolSelector(true)
exportExcel = Data.ExportExcel(filePath=code_block, sheetName=reverse, startRow=code_block_4, startCol=code_block_4, data=reverse_2, overWrite=boolean, lacing=Longest)
