# Dynamo custom node FFE Schedules & Room Numbers.dyf (Dynamo 2.0.4.12684)
# category: IAN
# Gets Standard BVN FFE Schedules and also a list of room numbers

getschedules_roomnumbers = Python()  # unwired: IN[0]
# ---------- getschedules_roomnumbers.python (65 lines) ----------
# Load the Python Standard and DesignScript Libraries
import sys
import clr
clr.AddReference('ProtoGeometry')
from Autodesk.DesignScript.Geometry import *

clr.AddReference("RevitAPI")
from Autodesk.Revit.DB import *

# Import DocumentManager and TransactionManager
clr.AddReference("RevitServices")
import RevitServices
from RevitServices.Persistence import DocumentManager
from RevitServices.Transactions import TransactionManager
doc = DocumentManager.Instance.CurrentDBDocument

clr.AddReference("System")
import System

clr.AddReference("System.Core")
clr.ImportExtensions(System.Linq)

from System.Collections.Generic import List
from System.Collections.Generic import *
#from System.Collections import Counter
from System import String

#------------------------------------------------------
def isValidRoomNumber(s):
	return True
#------------------------------------------------------

# The inputs to this node will be stored as a list in the IN variables.
dataEnteringNode = IN

# Place your code below this line
roomNumbers = []

# Get the Schedules
theSchedules = (
FilteredElementCollector(doc)
.OfCategory(BuiltInCategory.OST_Schedules)
.Where(lambda s: (s.Name.StartsWith('FFE SCHEDULE') and not 'SERVICES' in s.Name))
.ToList()
)

# Get the Room Numbers from the Schedules
for aSchedule in theSchedules:
	schedName = Element.Name.GetValue(aSchedule)
	roomnumber = schedName[-9:]
	if isValidRoomNumber(roomnumber):
		roomNumbers.Add(roomnumber)



output = []
output.Add(theSchedules)
output.Add(roomNumbers)


# Assign your output to the OUT variable.
#output = []


OUT = output
# ----------------------------------------
number = DoubleInput(1)
getItemAtIndex = List.GetItemAtIndex(list=getschedules_roomnumbers, index=number)
Room_Numbers = Output(getItemAtIndex)
number_2 = DoubleInput(0)
getItemAtIndex_2 = List.GetItemAtIndex(list=getschedules_roomnumbers, index=number_2)
FFE_Schedules = Output(getItemAtIndex_2)
