# Dynamo custom node FFE Services Schedules & Room Numbers.dyf (Dynamo 2.0.4.12684)
# category: IAN
# Gets Services FF&E Schedules that exist and don't exist in the model as separate lists

getServiceSchedules = Python()  # unwired: IN[0]
# ---------- getServiceSchedules.python (81 lines) ----------
# Load the Python Standard and DesignScript Libraries
import sys
import clr
clr.AddReference('ProtoGeometry')
from Autodesk.DesignScript.Geometry import *

clr.AddReference("RevitAPI")
from Autodesk.Revit.DB import *

# Import DocumentManager and TransactionManager
clr.AddReference("RevitServices")
import RevitServices
from RevitServices.Persistence import DocumentManager
from RevitServices.Transactions import TransactionManager
doc = DocumentManager.Instance.CurrentDBDocument

clr.AddReference("System")
import System

clr.AddReference("System.Core")
clr.ImportExtensions(System.Linq)

from System.Collections.Generic import List
from System.Collections.Generic import *
#from System.Collections import Counter
from System import String

#------------------------------------------------------
def isValidRoomNumber(s):
	return True
#------------------------------------------------------

# The inputs to this node will be stored as a list in the IN variables.
dataEnteringNode = IN

# Place your code below this line
roomNumbers = []

# Get the Schedules
theRoomSchedules = (
FilteredElementCollector(doc)
.OfCategory(BuiltInCategory.OST_Schedules)
.Where(lambda s: (s.Name.StartsWith('FFE SCHEDULE') and not 'SERVICES' in Element.Name.GetValue(s)))
.ToList()
)

# Get the Schedules
theServiceSchedules = (
FilteredElementCollector(doc)
.OfCategory(BuiltInCategory.OST_Schedules)
.Where(lambda s: s.Name.StartsWith('FFE SCHEDULE SERVICES'))
.ToList()
)

# Output Lists for Matching and Missing Schedules
matching = []
missing = []

# Get the Room Numbers from the Schedules
for aRoomSchedule in theRoomSchedules:
	schedName = Element.Name.GetValue(aRoomSchedule)
	roomnumber = schedName[-9:]
	found = False
	if isValidRoomNumber(roomnumber):
		# Check for a match against Room Schedules
		for aServiceSchedule in theServiceSchedules:
			if roomnumber in Element.Name.GetValue(aServiceSchedule):
				found = True
	if found:
		matching.Add(aServiceSchedule)
	else:
		missing.Add(roomnumber)

# Build the Output lists
output = []
output.Add(matching)
output.Add(missing)


# Assign your output to the OUT variable.
OUT = output
# ----------------------------------------
number = DoubleInput(1)
getItemAtIndex = List.GetItemAtIndex(list=getServiceSchedules, index=number)
Missing_Schedules = Output(getItemAtIndex)
number_2 = DoubleInput(0)
getItemAtIndex_2 = List.GetItemAtIndex(list=getServiceSchedules, index=number_2)
Matching_Schedules = Output(getItemAtIndex_2)
