# Dynamo graph LoganScheduleGrabber.dyn (Dynamo 2.0.4.12684)

ffe_schedules_room_numbers = Custom[FFE Schedules & Room Numbers]()  # Gets Standard BVN FFE Schedules and also a list of room numbers
watch = Watch(ffe_schedules_room_numbers.FFE_Schedules)
watch_2 = Watch(ffe_schedules_room_numbers.Room_Numbers)
ffe_services_schedules_room = Custom[FFE Services Schedules & Room Numbers]()  # Gets Services FF&E Schedules that exist and don't exist in the model as separate lists
watch_3 = Watch(ffe_services_schedules_room.Missing_Schedules)
watch_4 = Watch(ffe_services_schedules_room.Matching_Schedules)
